# Grasshopper definition L2.gh (Grasshopper 1.0.8)

# ---- group: random polygon stack generator
number_of_shapes_generated = Slider(8, range=0..100)
min_number_of_edges = Slider(3, range=0..100)
max_number_of_edges = Slider(8, range=0..100)
spacing_between = Slider(7.4, range=0..100)
construct_domain = ConstructDomain(DomainStart=min_number_of_edges, DomainEnd=max_number_of_edges)
series = Series(Start=0, Step=spacing_between, Count=number_of_shapes_generated)
random = Random(Range=construct_domain, Number=number_of_shapes_generated, Seed=2)
panel = Panel(random)
construct_point = ConstructPoint(XCoordinate=Slider(0, range=-100..100), YCoordinate=Slider(0, range=-100..100), ZCoordinate=series)
xy_plane = XYPlane(Origin=construct_point)
polygon = Polygon(Plane=xy_plane, Radius=Slider(50, range=0..100), Segments=random, FilletRadius=Slider(0, range=0..100))  # -> Polygon, Length

# ---- group: circle for twisted triangle connection
construct_point_2 = ConstructPoint(XCoordinate=Slider(300, range=0..1000), YCoordinate=Slider(150, range=0..1000), ZCoordinate=0)
xy_plane_2 = XYPlane(Origin=construct_point_2)
circle = Circle(Plane=xy_plane_2, Radius=Slider(45, range=0..100))

# ---- group: traingular prism stuff
number_of_shapes_generated_2 = Slider(30, range=0..100)
how_far_apart = Slider(8, range=0..100)
number_slider = Slider(150, range=0..1000)
number_slider_2 = Slider(250, range=0..1000)
series_2 = Series(Start=0, Step=how_far_apart, Count=number_of_shapes_generated_2)
construct_point_3 = ConstructPoint(XCoordinate=series_2, YCoordinate=number_slider_2, ZCoordinate=number_slider)
shape_generated_of_sides = Slider(3, range=0..100)
yz_plane = YZPlane(Origin=construct_point_3)
polygon_2 = Polygon(
    Plane=yz_plane,
    Radius=Slider(58, range=0..100),
    Segments=shape_generated_of_sides,
    FilletRadius=Slider(15, range=0..100))  # -> Polygon, Length

# ----
construct_point_4 = ConstructPoint(XCoordinate=0, YCoordinate=number_slider_2, ZCoordinate=number_slider)
area = Area(Geometry=polygon_2.Polygon)  # -> Area, Centroid
panel_2 = Panel(area.Centroid)

# ---- group: twist action
twist_angle = Slider(10, range=0..100)
multiplication = Multiplication(A=how_far_apart, B=number_of_shapes_generated_2)
construct_point_5 = ConstructPoint(XCoordinate=multiplication, YCoordinate=number_slider_2, ZCoordinate=number_slider)
line = Line(StartPoint=construct_point_4, EndPoint=construct_point_5)
twist = Twist(Geometry=polygon_2.Polygon, Axis=line, Angle=twist_angle, Infinite=False, Rigid=False)

# ----
merge = Merge(Data1=polygon.Polygon, Data2=twist, Data3=circle)  # -> reverse(flatten(Result))
loft = Loft(Curves=merge, Options={Adjust=False, Closed=False, LoftEnds=0, LoftSimp=0, LoftType=0, Rebuild=10, Refit=0.01})
cap_holes = CapHoles(Brep=loft)
geometry = Geometry(cap_holes)
manual_based_on_number_of_slices = Slider(4, range=0..10)

number_slider_3 = Slider(100, range=0..100)
construct_point_6 = ConstructPoint(XCoordinate=number_slider_3, YCoordinate=number_slider_3, ZCoordinate=0)
grid_size = Slider(300, range=0..1000)
xy_plane_3 = XYPlane(Origin=construct_point_6)
rectangle = Rectangle(Plane=xy_plane_3, XSize=grid_size, YSize=grid_size, Radius=0)  # -> Rectangle, Length
manual_based_on_number_of_slices_2 = Slider(4, range=0..10)
rectangular_array = RectangularArray(
    Geometry=rectangle.Rectangle,
    Cell=rectangle.Rectangle,
    XCount=manual_based_on_number_of_slices,
    YCount=manual_based_on_number_of_slices_2)  # -> Geometry, Transform

area_2 = Area(Geometry=rectangular_array.Geometry)  # -> Area, Centroid
manual_slice_input = Slider(37, range=0..100)
unit_x = UnitX(Factor=1)

# ---- group: slicer
material_thickness = Slider(19.8, range=0..100)
unit_z = UnitZ(Factor=1)
take_contours_of_object_surface_on_xy_pl = Contour(Shape=geometry, Point=Point(0, 0, 0), Direction=unit_z, Distance=material_thickness)  # "Take contours of object surface on xy plane moving in z"
move_to_plane = MoveToPlane(Geometry=take_contours_of_object_surface_on_xy_pl, Plane=PlaneXY(0, 0, 0), Above=True, Below=True)  # -> flatten(Geometry), Transform
series_3 = Series(Start=Slider(0, range=0..100), Step=1, Count=manual_slice_input)
graft_tree = GraftTree(Tree=series_3, IncludeEmptyLists=True, IncludeNullItems=True)

# ----
graft_tree_2 = GraftTree(Tree=take_contours_of_object_surface_on_xy_pl, IncludeEmptyLists=True, IncludeNullItems=True)
closed = Closed(Curve=move_to_plane.Geometry)  # -> Closed, Periodic
cull_pattern = CullPattern(List=move_to_plane.Geometry, CullPattern=closed.Closed)
area_3 = Area(Geometry=cull_pattern)  # -> Area, Centroid
orient = Orient(Geometry=cull_pattern, Source=area_3.Centroid, Target=area_2.Centroid)  # -> Geometry, Transform

# ---- group: slicer (continued)
graft_tree_3 = GraftTree(Tree=orient.Geometry, IncludeEmptyLists=True, IncludeNullItems=True)
area_4 = Area(Geometry=graft_tree_3)  # -> Area, Centroid
move = Move(Geometry=area_4.Centroid, Motion=unit_x)  # -> Geometry, Transform
line_2 = Line(StartPoint=move.Geometry, EndPoint=area_4.Centroid)
surface = Surface(graft_tree_3)
text_on_surface = TextOnSurface(Text=graft_tree, Font="Sans Bold:no Italic:no", Height=1, Depth=0.4, BaseLine=line_2, BaseSurface=surface)

# ----
panel_3 = Panel(series_3)
