# Grasshopper definition m3.gh (Grasshopper 1.0.8)

# ---- group: shelf
series = Series(Start=Slider(15, range=0..100), Step=Slider(15, range=-11..100), Count=Slider(3, range=0..10))
number_slider = Slider(175, range=0..1000)
series_2 = Series(Start=0, Step=Slider(15, range=-11..100), Count=Slider(4, range=0..10))
number_slider_2 = Slider(150, range=0..1000)
construct_point = ConstructPoint(XCoordinate=number_slider, YCoordinate=number_slider, ZCoordinate=series)
number_slider_3 = Slider(175, range=0..1000)
xy_plane = XYPlane(Origin=construct_point)
construct_point_2 = ConstructPoint(XCoordinate=number_slider_3, YCoordinate=number_slider_3, ZCoordinate=series_2)
construct_point_3 = ConstructPoint(XCoordinate=number_slider_2, YCoordinate=number_slider_2, ZCoordinate=0)
rectangle = Rectangle(Plane=xy_plane, XSize=Slider(40, range=0..100), YSize=Slider(20, range=0..100), Radius=0)  # -> Rectangle, Length
number_slider_4 = Slider(50, range=0..100)
xy_plane_2 = XYPlane(Origin=construct_point_2)
xy_plane_3 = XYPlane(Origin=construct_point_3)
box_rectangle = BoxRectangle(Rectangle=rectangle.Rectangle, Height=Slider(5, range=0..10))
rectangle_2 = Rectangle(Plane=xy_plane_3, XSize=number_slider_4, YSize=number_slider_4, Radius=0)  # -> Rectangle, Length
sphere = Sphere(Base=xy_plane_2, Radius=Slider(10, range=0..100))
surface = Surface(rectangle_2.Rectangle)
solid_difference = SolidDifference(BrepsA=sphere, BrepsB=surface)

# ---- group: table
number_slider_5 = Slider(5, range=0..10)
number_slider_6 = Slider(10, range=0..100)
construct_domain = ConstructDomain(DomainStart=number_slider_6, DomainEnd=Slider(100, range=0..100))
height_of_other_circle_step_of_radius_of = Slider(55, range=0..100)  # "height of other circle + step of radius of cone"
construct_point_4 = ConstructPoint(XCoordinate=0, YCoordinate=0, ZCoordinate=Slider(45, range=0..100))
construct_point_5 = ConstructPoint(XCoordinate=0, YCoordinate=0, ZCoordinate=Slider(45, range=0..100))
series_3 = Series(Start=0, Step=Slider(1, range=0..1), Count=Slider(50, range=0..100))
series_4 = Series(Start=number_slider_6, Step=1, Count=construct_domain)
xy_plane_4 = XYPlane(Origin=construct_point_4)
construct_point_6 = ConstructPoint(XCoordinate=0, YCoordinate=0, ZCoordinate=series_3)
xy_plane_5 = XYPlane(Origin=construct_point_5)
circle = Circle(Plane=xy_plane_4, Radius=Slider(100, range=0..100))
xy_plane_6 = XYPlane(Origin=construct_point_6)
circle_2 = Circle(Plane=xy_plane_5, Radius=height_of_other_circle_step_of_radius_of)
circle_3 = Circle(Plane=xy_plane_6, Radius=series_4)
surface_2 = Surface(circle_2)
merge = Merge(Data1=circle_3, Data2=circle)  # -> reverse(flatten(Result))
solid_difference_2 = SolidDifference(BrepsA=circle, BrepsB=surface_2)
loft = Loft(Curves=merge, Options={Adjust=False, Closed=False, LoftEnds=0, LoftSimp=0, LoftType=0, Rebuild=10, Refit=0.01})
cap_holes = CapHoles(Brep=loft)
merge_2 = Merge(Data1=cap_holes, Data2=solid_difference_2)
geometry = Geometry(merge_2)

# ---- group: chair
series_5 = Series(Start=0, Step=Slider(15, range=-11..100), Count=Slider(2, range=0..10))
number_slider_7 = Slider(-204, range=-1000..1000)
number_slider_8 = Slider(-175, range=-1000..1001)
construct_point_7 = ConstructPoint(XCoordinate=number_slider_8, YCoordinate=number_slider_8, ZCoordinate=series_5)
construct_point_8 = ConstructPoint(XCoordinate=number_slider_7, YCoordinate=number_slider_7, ZCoordinate=0)
number_slider_9 = Slider(50, range=0..100)
xy_plane_7 = XYPlane(Origin=construct_point_7)
xy_plane_8 = XYPlane(Origin=construct_point_8)
rectangle_3 = Rectangle(Plane=xy_plane_8, XSize=number_slider_9, YSize=number_slider_9, Radius=0)  # -> Rectangle, Length
sphere_2 = Sphere(Base=xy_plane_7, Radius=Slider(10, range=0..100))
construct_point_9 = ConstructPoint(
    XCoordinate=Slider(-175, range=-1000..1001),
    YCoordinate=Slider(-173, range=-1000..1001),
    ZCoordinate=Slider(31, range=-11..100))
construct_point_10 = ConstructPoint(
    XCoordinate=Slider(-175, range=-1000..1001),
    YCoordinate=Slider(-181, range=-1000..1001),
    ZCoordinate=Slider(22, range=-11..100))
construct_point_11 = ConstructPoint(
    XCoordinate=Slider(-175, range=-1000..1001),
    YCoordinate=Slider(-160, range=-1000..1001),
    ZCoordinate=Slider(12, range=-11..100))
construct_point_12 = ConstructPoint(
    XCoordinate=Slider(-175, range=-1000..1001),
    YCoordinate=Slider(-163, range=-1000..1001),
    ZCoordinate=Slider(26, range=-11..100))
surface_3 = Surface(rectangle_3.Rectangle)
xy_plane_9 = XYPlane(Origin=construct_point_9)
xy_plane_10 = XYPlane(Origin=construct_point_10)
xz_plane = XZPlane(Origin=construct_point_11)
xz_plane_2 = XZPlane(Origin=construct_point_12)
solid_difference_3 = SolidDifference(BrepsA=sphere_2, BrepsB=surface_3)
sphere_3 = Sphere(Base=xy_plane_9, Radius=Slider(11, range=0..100))
sphere_4 = Sphere(Base=xy_plane_10, Radius=Slider(11, range=0..100))
sphere_5 = Sphere(Base=xz_plane_2, Radius=Slider(10, range=0..10))
center_box = CenterBox(Base=xz_plane, X=Slider(9, range=0..100), Y=Slider(12, range=0..100), Z=1)
solid_difference_4 = SolidDifference(BrepsA=sphere_5, BrepsB=sphere_3)
solid_difference_5 = SolidDifference(BrepsA=center_box, BrepsB=solid_difference_4)
solid_difference_6 = SolidDifference(BrepsA=solid_difference_3, BrepsB=sphere_4)
solid_difference_7 = SolidDifference(BrepsA=solid_difference_6, BrepsB=sphere_3)
solid_union = SolidUnion(Breps=[solid_difference_7, solid_difference_5, solid_difference_4])  # -> flatten(Result)
geometry_2 = Geometry(solid_union)

# ----
solid_union_2 = SolidUnion(Breps=[box_rectangle, solid_difference])
geometry_3 = Geometry(solid_union_2)
